# Dynamo graph Excel Sheet Index to Revit Placeholder Sheets.dyn (Dynamo 2.0.3.8810)

# note: Excel Sheet Index to Revit Placeholder Sheets
# Version 0.6
# Coded by Andrew King
# https://andrewkingme.com
# 2018-09-07 Version 0.6
# Added String.ToNumber for PlotSequence parameter.
# 2018-05-03 Version 0.5
# Added PlotSequence parameter. Set readAsStrings to true.
# 2017-01-17 Version 0.4
# Added List.RemoveItemAtIndex to remove headers from Excel data. Implemented design phase designation.
# 2017-01-03 Version 0.3
# Replace Excel null values with "" to avoid a list mismatch. Refactored Python code.
# 2017-01-03 Version 0.2
# Added ability to modify additional sheet parameters (sheetDiscipline).
# 2017-01-03 Version 0.1
# Hello World

# group: Excel Sheet Index
file_path = Filename(".\SheetIndex_Template.xlsx")

fromPath = FileObject(path=file_path)  # "File.FromPath"
code_block = CodeBlock { "Sheet1"; true; }
importExcel = Data.ImportExcel(file=fromPath, sheetName=code_block.out0, readAsStrings=code_block.out1)
code_block_2 = CodeBlock { 0..1; }
removeItemAtIndex = List.RemoveItemAtIndex(list=importExcel, indices=code_block_2)
code_block_3 = CodeBlock { 0; 1; 2; 3; 4; 5; 6; 7; }
getItemAtIndex = List.GetItemAtIndex(list=removeItemAtIndex@L2, index=code_block_3.out0)
code_block_4 = CodeBlock { ""; }
isNull = Object.IsNull()  # unwired: obj
replaceByCondition = Replace(item=getItemAtIndex, replaceWith=code_block_4, condition=isNull)
getItemAtIndex_2 = List.GetItemAtIndex(list=removeItemAtIndex@L2, index=code_block_3.out1)
replaceByCondition_2 = Replace(item=getItemAtIndex_2, replaceWith=code_block_4, condition=isNull)
getItemAtIndex_3 = List.GetItemAtIndex(list=removeItemAtIndex@L2, index=code_block_3.out2)
replaceByCondition_3 = Replace(item=getItemAtIndex_3, replaceWith=code_block_4, condition=isNull)
getItemAtIndex_4 = List.GetItemAtIndex(list=removeItemAtIndex@L2, index=code_block_3.out3)
replaceByCondition_4 = Replace(item=getItemAtIndex_4, replaceWith=code_block_4, condition=isNull)
getItemAtIndex_5 = List.GetItemAtIndex(list=removeItemAtIndex@L2, index=code_block_3.out4)
replaceByCondition_5 = Replace(item=getItemAtIndex_5, replaceWith=code_block_4, condition=isNull)
getItemAtIndex_6 = List.GetItemAtIndex(list=removeItemAtIndex@L2, index=code_block_3.out5)
replaceByCondition_6 = Replace(item=getItemAtIndex_6, replaceWith=code_block_4, condition=isNull)
getItemAtIndex_7 = List.GetItemAtIndex(list=removeItemAtIndex@L2, index=code_block_3.out6)
replaceByCondition_7 = Replace(item=getItemAtIndex_7, replaceWith=code_block_4, condition=isNull)
getItemAtIndex_8 = List.GetItemAtIndex(list=removeItemAtIndex@L2, index=code_block_3.out7)
replaceByCondition_8 = Replace(item=getItemAtIndex_8, replaceWith=code_block_4, condition=isNull)
python_script = Python(IN[0]=replaceByCondition, IN[1]=replaceByCondition_2, IN[2]=replaceByCondition_3, IN[3]=replaceByCondition_4, IN[4]=replaceByCondition_5, IN[5]=replaceByCondition_6, IN[6]=replaceByCondition_7, IN[7]=replaceByCondition_8)
# ---------- python_script.python (53 lines) ----------
# Python Node for Dynamo
# Excel Sheet Index to Revit Placeholder Sheets
# Coded by Andrew King
# https://andrewkingme.com

import clr
clr.AddReference('ProtoGeometry')
from Autodesk.DesignScript.Geometry import *

# Import RevitAPI
clr.AddReference('RevitAPI')
import Autodesk
from Autodesk.Revit.DB import *

# Import DocumentManager and TransactionManager
clr.AddReference('RevitServices')
import RevitServices
from RevitServices.Persistence import DocumentManager
from RevitServices.Transactions import TransactionManager

# Assign input to the IN variables.
sheetNumbers = IN[0]
sheetNames = IN[1]
sheetDiscipline = IN[2]
sheetPlotSequence = IN[3]
sheet50SD = IN[4]
sheet100SD = IN[5]
sheet50DD = IN[6]
sheet100DD = IN[7]

sheets = []

# Start the Transaction
TransactionManager.Instance.EnsureInTransaction(DocumentManager.Instance.CurrentDBDocument)

# Create Placeholder Sheets and Assign Parameter Values
for s0, s1, s2, s3, s4, s5, s6, s7 in zip(sheetNumbers, sheetNames, sheetDiscipline, sheetPlotSequence, sheet50SD, sheet100SD, sheet50DD, sheet100DD):
	newSheet = ViewSheet.CreatePlaceholder(DocumentManager.Instance.CurrentDBDocument)
	newSheet.SheetNumber = s0
	newSheet.Name = s1
	newSheet.LookupParameter('Discipline').Set(s2)
	newSheet.LookupParameter('PlotSequence').Set(s3)
	newSheet.LookupParameter('50% SD').Set(s4)
	newSheet.LookupParameter('100% SD').Set(s5)
	newSheet.LookupParameter('50% DD').Set(s6)
	newSheet.LookupParameter('100% DD').Set(s7)
	sheets.append('Added Placeholder ' + newSheet.SheetNumber.ToString())

# End the Transaction
TransactionManager.Instance.TransactionTaskDone()

#Assign your output to the OUT variable
OUT = sheets
# ----------------------------------------
watch = Watch(python_script)
