# Dynamo graph Purge Existing Placeholder Sheets.dyn (Dynamo 2.0.3.8810)

# note: Purge Existing Placeholder Sheets
# Version 0.1
# Coded by Andrew King
# https://andrewkingme.com
# 2017-01-03 Version 0.1
# Hello World
categories = Categories(index=437)  # graph input
all_elements_of_category = ElementsOfCategory(Category=categories)
python_script = Python(IN[0]=all_elements_of_category)
# ---------- python_script.python (35 lines) ----------
# Python Node for Dynamo
# Purge Existing Placeholder Sheets
# Coded by Andrew King
# https://andrewkingme.com

import clr
clr.AddReference('ProtoGeometry')
from Autodesk.DesignScript.Geometry import *

# Import RevitAPI
clr.AddReference('RevitAPI')
import Autodesk
from Autodesk.Revit.DB import *

# Import DocumentManager and TransactionManager
clr.AddReference('RevitServices')
import RevitServices
from RevitServices.Persistence import DocumentManager
from RevitServices.Transactions import TransactionManager

# Assign input to the IN variables.
sheets = UnwrapElement(IN[0])

deleted = []

TransactionManager.Instance.EnsureInTransaction(DocumentManager.Instance.CurrentDBDocument)

for s in sheets:
	if s.IsPlaceholder:
		deleted.append('Deleted Placeholder ' + s.SheetNumber.ToString())
		DocumentManager.Instance.CurrentDBDocument.Delete(s.Id)

TransactionManager.Instance.TransactionTaskDone()
		
OUT = deleted
# ----------------------------------------
watch = Watch(python_script)
